# Grasshopper definition runner.ghx (Grasshopper 1.0.7)

# ---- group: Module Watcher
modulewatcher = GhPythonScript(enable=Toggle(True))  # -> out; inputs enable: Boolean
# ---------- modulewatcher: Python ----------
from develop import watch_modules


watch_modules(enable)
# ---------- end modulewatcher ----------
panel = Panel(modulewatcher)

# ----
examplecode = GhPythonScript()  # -> out, a
# ---------- examplecode: Python ----------
from logic import say_hi


say_hi()
# ---------- end examplecode ----------

# ---- group: Manual Module Importer
modulereloader = GhPythonScript(run=Button())  # -> out; inputs run: Boolean
# ---------- modulereloader: Python ----------
import os
import sys

# Import가 제대로 작동하도록 PATH를 업데이트한다.
# 그렇기 때문에 이 컴포넌트는 가장 먼저 실행되어야 한다.
# 이 파이썬 컴포넌트를 `ctrl+B`로 가장 뒤로 보내 놓아야
# 모든 컴포넌트들 중 제일 먼저 실행된다.
root_dir = os.path.dirname(ghdoc.Path)
if root_dir not in sys.path:
    sys.path.append(root_dir)

from develop import reload_modules

reload_modules(run)
# ---------- end modulereloader ----------
